# Grasshopper definition truchet_multiscale.gh (Grasshopper 0.9.80)

# ---- group: OUTPUT / CONTROLS
num_to_cull = Slider(495, range=0..1000)
random_cull_seed = Slider(47, range=0..100)
grid_size = Slider(40, range=0..100)

# ---- group: Create the grid
number_slider = Slider(10, range=1..10)
int = Integer(grid_size)
division = Division(A=int, B=Slider(2, range=1..5))
sqgrid = Square(Plane=PlaneXY(0, 0, 0), Size=number_slider, ExtentX=int, ExtentY=division)  # -> Cells, Points
pcen = PolygonCenter(Polyline=sqgrid.Cells)  # -> CenterV, CenterE, flatten(CenterA)

# ----
points = PointList(Points=pcen.CenterA)
multiplication = Multiplication(A=int, B=Slider(2, range=1..5))

# ---- group: Move the pre-made geometry to each cell
pt = ConstructPoint(XCoordinate=expr("x/2", number_slider), YCoordinate=expr("x/2", number_slider), ZCoordinate=0)
crv = Curve([<curve referenced from the Rhino model> x24])
group = Group(Objects=crv)
vec2pt = Vector2Pt(PointA=pt, PointB=pcen.CenterA, Unitize=False)  # -> Vector, Length
move = Move(Geometry=group, Motion=vec2pt.Vector)  # -> flatten(Geometry), Transform

# ----
xy = XYPlane(Origin=pcen.CenterA)

# ---- group: Create the grid
number_slider_2 = Slider(25, range=1..100)
division_2 = Division(A=int, B=Slider(2, range=1..5))
number_slider_3 = Slider(10, range=1..10)

# ----
multiplication_2 = Multiplication(A=division_2, B=Slider(2, range=1..5))

# ---- group: Create the grid (continued)
sqgrid_2 = Square(Plane=PlaneXY(0, 0, 0), Size=expr("x / 2", number_slider_3), ExtentX=multiplication, ExtentY=multiplication_2)  # -> Cells, Points
pcen_2 = PolygonCenter(Polyline=sqgrid_2.Cells)  # -> CenterV, CenterE, flatten(CenterA)

# ---- group: Move the pre-made geometry to each cell
pt_2 = ConstructPoint(XCoordinate=expr("x/4", number_slider_3), YCoordinate=expr("x/4", number_slider_3), ZCoordinate=0)
crv_2 = Curve([<curve referenced from the Rhino model> x11])
group_2 = Group(Objects=crv_2)
vec2pt_2 = Vector2Pt(PointA=pt_2, PointB=pcen_2.CenterA, Unitize=False)  # -> Vector, Length
move_2 = Move(Geometry=group_2, Motion=vec2pt_2.Vector)  # -> flatten(Geometry), Transform

# ----
xy_2 = XYPlane(Origin=pcen_2.CenterA)

# ---- group: OUTPUT
random_rot_seed_level_0 = Slider(4, range=0..10)
random_rot_seed_level_1 = Slider(8, range=0..10)

# ----
int_2 = Integer(random_rot_seed_level_1)

# ---- group: Randomly rotate every cell (a multiple of 90)
lng = ListLength(List=move.Geometry)
int_3 = Integer(random_rot_seed_level_0)
random = Random(Range=Domain(0, 1), Number=lng, Seed=int_3)
multiplication_3 = Multiplication(A=random, B=Slider(6, range=0..10))
addition = Addition(A=multiplication_3, B=Slider(1, range=0..1))
round = Round(Number=addition)  # -> Nearest, Floor, Ceiling
panel = Panel(round.Floor)
multiplication_4 = Multiplication(A=Slider(90, range=0..360), B=panel)

lng_2 = ListLength(List=move_2.Geometry)
random_2 = Random(Range=Domain(0, 1), Number=lng_2, Seed=int_2)
multiplication_5 = Multiplication(A=random_2, B=Slider(6, range=0..10))
addition_2 = Addition(A=multiplication_5, B=Slider(1, range=0..1))
round_2 = Round(Number=addition_2)  # -> Nearest, Floor, Ceiling
panel_2 = Panel(round_2.Floor)
multiplication_6 = Multiplication(A=Slider(90, range=0..360), B=panel_2)

# ----
rotate = Rotate(Geometry=move.Geometry, Angle=degrees(multiplication_4), Plane=xy)  # -> Geometry, Transform
rotate_2 = Rotate(Geometry=move_2.Geometry, Angle=degrees(multiplication_6), Plane=xy_2)  # -> Geometry, Transform

# ---- group: Remove a random amount of tiles
lng_3 = ListLength(List=rotate.Geometry)
dom = ConstructDomain(DomainStart=0, DomainEnd=expr("x-1", lng_3))
number_to_cull = Integer(num_to_cull)
random_seed = Integer(random_cull_seed)
random_3 = Random(Range=dom, Number=number_to_cull, Seed=random_seed)
round_3 = Round(Number=random_3)  # -> Nearest, Floor, Ceiling
panel_3 = Panel(round_3.Floor)

# ---- group: Get the {x,y} of the Level_0 Grid
indices = Integer(panel_3)
width = Integer(division)
mod = Modulus(A=indices, B=width)
integer_division = IntegerDivision(A=indices, B=width)
y = Integer(integer_division)
x = Integer(mod)

# ---- group: Covert to the {x,y} of the Level_1 Grid
_2 = B(2)
_2_2 = B(2)
_2_3 = B(2)
multiplication_7 = Multiplication(A=y, B=_2)
multiplication_8 = Multiplication(A=x, B=_2_2)
multiplication_9 = Multiplication(A=width, B=_2_3)
integer = Integer(multiplication_7)
width_2 = Integer(multiplication_9)
integer_2 = Integer(multiplication_8)
_1 = B(1)
addition_3 = Addition(A=integer, B=_1)
multiplication_10 = Multiplication(A=integer, B=width_2)
multiplication_11 = Multiplication(A=addition_3, B=width_2)
addition_4 = Addition(A=integer_2, B=multiplication_10)
addition_5 = Addition(A=integer_2, B=multiplication_11)

# ---- group: Composite the 2 Grids
item = ListItem(List=rotate_2.Geometry, Index=expr("x+1", addition_4), Wrap=False)
item_2 = ListItem(List=rotate_2.Geometry, Index=expr("x+1", addition_5), Wrap=False)
cull_i = CullIndex(List=rotate.Geometry, Indices=panel_3, Wrap=True)
item_3 = ListItem(List=rotate_2.Geometry, Index=addition_4, Wrap=False)
item_4 = ListItem(List=rotate_2.Geometry, Index=addition_5, Wrap=False)

# ---- group: OUTPUT (continued)
final_geometry = Geometry([cull_i, item_3, item, item_4, item_2])
